# Grasshopper definition Flickr density.gh (Grasshopper 1.0.8)
# plug-ins: Human

file_path = FilePath("C:\Users\douhan0925\Desktop\flikcr.csv")
get_number = GetNumber(AtLeast=1, AtMost=1, Maximum=1.797693135e+308, Minimum=-1.797693135e+308, TreeAccess=False)
construct_domain = ConstructDomain(DomainStart=Slider(0.5, range=0..1), DomainEnd=Slider(4.5, range=0..10))
bounds = Bounds(Numbers=get_number)
construct_domain_2 = ConstructDomain(DomainStart=Slider(0, range=-500..501), DomainEnd=Slider(867, range=0..10000))
remap_numbers = RemapNumbers(Value=get_number, Source=bounds, Target=construct_domain)  # -> Mapped, Clipped
curve = Curve(<curve referenced from the Rhino model>)
number_slider = Slider(100, range=0..100)
boundary_surfaces = BoundarySurfaces(Edges=curve)
point = Point([Point(1369058.059, 5693407.659, 0), Point(1377777.34, 5693386.05, 0), Point(1377820.893, 5687240.374, 0), Point(1368969.556, 5687279.323, 0)])
divide_surface = DivideSurface(Surface=boundary_surfaces, UCount=number_slider, VCount=number_slider)  # -> Points, Normals, Parameters
unit_z = UnitZ(Factor=1)
addition = Addition(A=number_slider, B=Slider(1, range=0..1))
subd_from_mesh = SubDFromMesh(Creases=2, Corners=2, Interpolate=Toggle(True))
number_slider_2 = Slider(200, range=0..500)
number_slider_3 = Slider(100, range=0..100)
divide_domain² = DivideDomain²(UCount=number_slider_2, VCount=number_slider_2)
number_slider_4 = Slider(100, range=0..100)
isotrim = Isotrim(Domain=divide_domain²)
divide_domain²_2 = DivideDomain²(UCount=10, VCount=10)
curve_2 = Curve(isotrim)
unit_z_2 = UnitZ(Factor=1)
isotrim_2 = Isotrim()
contour = Contour(Point=Point(0, 0, 0), Direction=unit_z_2, Distance=Slider(30, range=0..100))
curve_middle = CurveMiddle(Curve=contour)
deconstruct = Deconstruct(Point=curve_middle)  # -> XComponent, YComponent, flatten(ZComponent)
number_slider_5 = Slider(0, range=0..100)
number_slider_6 = Slider(1, range=0..1)
bounds_2 = Bounds(Numbers=deconstruct.ZComponent)
bounds_3 = Bounds(Numbers=deconstruct.ZComponent)
construct_domain_3 = ConstructDomain(DomainStart=number_slider_5, DomainEnd=number_slider_6)
deconstruct_domain = DeconstructDomain(Domain=bounds_2)  # -> Start, End
remap_numbers_2 = RemapNumbers(Value=deconstruct.ZComponent, Source=bounds_3, Target=construct_domain_3)  # -> Mapped, Clipped
gradient = Gradient(
    LowerLimit=number_slider_5,
    UpperLimit=number_slider_6,
    Parameter=remap_numbers_2.Mapped,
    stops=[0: RGB(0, 128, 0), 0.5: RGB(255, 255, 0), 1: RGB(255, 0, 0)])
custom_preview_lineweights = CustomPreviewLineweights(Geometry=contour, Shader=gradient, Absolute=False)

flatten_tree = FlattenTree(Path="{0}")
list_item = ListItem(List=flatten_tree, Index=0, Wrap=True)
reverse = Reverse(Vector=list_item)
move = Move(Geometry=flatten_tree, Motion=reverse)  # -> Geometry, Transform
scale = Scale(Geometry=move.Geometry, Center=Point(0, 0, 0), Factor=Slider(10, range=0..10))  # -> Geometry, Transform

read_file = ReadFile(File=file_path, PerLineParse=True)
cull_index = CullIndex(List=read_file, Indices="0", Wrap=True)
tab = Panel(",")
panel = Panel(read_file)
text_split = TextSplit(Text=cull_index, Separators=tab)
panel_2 = Panel(text_split)
list_item_2 = ListItem(List=panel_2, Index=Slider(1, range=0..100), Wrap=True)  # -> flatten(Item), Item1

list_item_3 = ListItem(List=text_split, Index=Slider(0, range=0..100), Wrap=True)  # -> flatten(Item)
panel_3 = Panel(list_item_3)
list_item_4 = ListItem(List=panel_2, Index=Slider(2, range=0..100), Wrap=True)  # -> flatten(Item), Item1
get_number_2 = GetNumber(list_item_3, AtLeast=1, AtMost=1, Maximum=1.797693135e+308, Minimum=-1.797693135e+308, TreeAccess=False)
bounds_4 = Bounds(Numbers=get_number_2)

construct_point = ConstructPoint(XCoordinate=list_item_2.Item, YCoordinate=list_item_4.Item, ZCoordinate=0)

remap_numbers_3 = RemapNumbers(Value=get_number_2, Source=bounds_4, Target=construct_domain_2)  # -> Mapped, Clipped
unit_z_3 = UnitZ(Factor=remap_numbers_3.Mapped)
move_2 = Move(Geometry=construct_point, Motion=unit_z_3)  # -> Geometry, Transform
merge = Merge(Data1=point, Data2=move_2.Geometry)
delaunay_mesh = DelaunayMesh(Points=merge, Plane=PlaneXY(0, 0, 0))
mesh_ray = MeshRay(Mesh=delaunay_mesh, Point=divide_surface.Points, Direction=unit_z)  # -> flatten(Point), Hit
surface_from_points = SurfaceFromPoints(Points=mesh_ray.Point, UCount=addition, Interpolate=False)  # -> flatten(Surface)

# ---- group: Graphics & Baking
contour_2 = Contour(Shape=surface_from_points, Point=Point(0, 0, 0), Direction=Vector(0, 0, 1), Distance=Slider(0, range=0..100))
evaluate_curve = EvaluateCurve(Curve=contour_2, Parameter=0)  # -> Point, Tangent, Angle
deconstruct_2 = Deconstruct(Point=evaluate_curve.Point)  # -> XComponent, YComponent, ZComponent
bounds_5 = Bounds(Numbers=flatten(deconstruct_2.ZComponent))
deconstruct_domain_2 = DeconstructDomain(Domain=bounds_5)  # -> Start, End
gradient_2 = Gradient(
    LowerLimit=deconstruct_domain_2.Start,
    UpperLimit=deconstruct_domain_2.End,
    Parameter=flatten(deconstruct_2.ZComponent),
    stops=[0: RGB(237, 184, 214), 0.00663: RGB(255, 38, 38), 0.804: RGB(255, 251, 0), 1: RGB(20, 126, 219)])
createattributes = CreateAttributes(LayerName="Contours", Color=gradient_2, enableFullPath=False)
custom_preview = CustomPreview(Geometry=flatten(contour_2), Material=gradient_2)
bake_geometry = BakeGeometry(Bake=Button(), Geometry=flatten(contour_2), Attributes=createattributes, DeleteOldBakes=False, PreserveTrees=False)
