# Grasshopper definition Sentiment.gh (Grasshopper 1.0.8)
# plug-ins: Human

file_path = FilePath()
read_file = ReadFile(File=file_path, PerLineParse=True)
# Reading textfiles (with Grasshopper)
# Bake with attributes (optional)
panel = Panel(read_file)
cull_index = CullIndex(List=read_file, Indices="0", Wrap=True)
tab = Panel(",")
text_split = TextSplit(Text=cull_index, Separators=tab)
panel_2 = Panel(text_split)
list_item = ListItem(List=panel_2, Index=Slider(7, range=0..100), Wrap=True)  # -> flatten(Item), Item1
list_item_2 = ListItem(List=panel_2, Index=Slider(8, range=0..100), Wrap=True)  # -> flatten(Item), Item1
list_item_3 = ListItem(List=text_split, Index=Slider(0, range=0..100), Wrap=True)  # -> flatten(Item)
get_number = GetNumber(list_item_3, AtLeast=1, AtMost=1, Maximum=1.797693135e+308, Minimum=-1.797693135e+308, TreeAccess=False)
get_number_2 = GetNumber(list_item.Item, AtLeast=1, AtMost=1, Maximum=1.797693135e+308, Minimum=-1.797693135e+308, TreeAccess=False)
get_number_3 = GetNumber(list_item_2.Item, AtLeast=1, AtMost=1, Maximum=1.797693135e+308, Minimum=-1.797693135e+308, TreeAccess=False)
construct_point = ConstructPoint(XCoordinate=get_number_2, YCoordinate=get_number_3, ZCoordinate=0)
bounds = Bounds(Numbers=get_number)
multiplication = Multiplication(A=get_number, B=Slider(1, range=0..10))
remap_numbers = RemapNumbers(Value=get_number, Source=Domain(0, 1), Target=multiplication)  # -> Mapped, Clipped
unit_z = UnitZ(Factor=remap_numbers.Mapped)
move = Move(Geometry=construct_point, Motion=unit_z)  # -> Geometry, Transform
merge = Merge(Data2=move.Geometry)
bake_geometry = BakeGeometry(Bake=Button(), Geometry=merge, DeleteOldBakes=False, PreserveTrees=False)
point = Point([<point referenced from the Rhino model> x2230])  # disabled
geometry = Geometry([<point referenced from the Rhino model> x2230])
deconstruct = Deconstruct(Point=geometry)  # -> XComponent, YComponent, ZComponent

# ---- group: Input
x = Panel("50")
y = Panel("30")

# ---- group: Inclusion
square = Square(Plane=PlaneXY(0, 0, 0), Size=1, ExtentX=x, ExtentY=y)  # -> flatten(Cells), Points
area = Area(Geometry=square.Cells)  # -> Area, Centroid
merge_2 = Merge(Data1=geometry, Data2=area.Centroid)
point_2 = Point(merge_2)
point_in_curves = PointInCurves(Point=point_2, Curves=square.Cells)  # -> Relationship, Index, Point

# ----
panel_3 = Panel(area.Centroid)

# ---- group: Check one cell
equality = Equality(FirstNumber=point_in_curves.Index, SecondNumber="12")  # -> Equality, Inequality
cull_pattern = CullPattern(List=point_2, CullPattern=equality.Equality)

# ----
panel_4 = Panel(point_2)

# ---- group: Check all cells
multiplication_2 = Multiplication(A=x, B=y)
series = Series(Start=0, Step=1, Count=multiplication_2)  # -> simplify(graft(Series))
equality_2 = Equality(FirstNumber=point_in_curves.Index, SecondNumber=series)  # -> Equality, Inequality
cull_pattern_2 = CullPattern(List=point_2, CullPattern=equality_2.Equality)
panel_5 = Panel(cull_pattern_2)

# ----
dispatch = Dispatch(List=deconstruct.ZComponent, DispatchPattern=equality_2.Equality)  # -> ListA, ListB
# 真实地理
# Field values of OSM are here:
# https://wiki.openstreetmap.org/wiki/Map_features
# you can test example values here:
# https://www.openstreetmap.org/node/6429327326
# 
# The format is
# [Key],[Value]
# 数值热力（不会做版
# How do you read the result?
# 
# The first line isn0 | 21
# and that means that Point 0 is in
# curve 21
# 
# Same is true for
# 1 | 21
# 
# And the third line is 2 | 12
# and that means that point 2
# is in curve 12.
panel_6 = Panel(dispatch.ListA)
average = Average(Input=dispatch.ListA)
panel_7 = Panel(average)
panel_8 = Panel(point_in_curves.Index)
replace_nulls = ReplaceNulls(Items=panel_7, Replacements=Slider(0, range=0..100))  # -> flatten(Items), Count
panel_9 = Panel(merge_2)
# Add contrast by "streching" the numbers
panel_10 = Panel(replace_nulls.Items)
tree_statistics = TreeStatistics(Tree=cull_pattern_2)  # -> Paths, Length, Count

# ---- group: Surface Grid
construct_domain = ConstructDomain(DomainStart="0", DomainEnd="6")
bounds_2 = Bounds(Numbers=flatten(panel_10))
remap_numbers_2 = RemapNumbers(Value=panel_10, Source=bounds_2, Target=construct_domain)  # -> Mapped, Clipped
unit_z_2 = UnitZ(Factor=remap_numbers_2.Mapped)
move_2 = Move(Geometry=area.Centroid, Motion=unit_z_2)  # -> Geometry, Transform
surface_from_points = SurfaceFromPoints(Points=move_2.Geometry, UCount=x, Interpolate=False)

# ----
panel_11 = Panel(tree_statistics.Length)
panel_12 = Panel(unit_z_2)

# ---- group: Graphics & Baking
contour = Contour(Shape=surface_from_points, Point=Point(0, 0, 0), Direction=Vector(0, 0, 1), Distance=Slider(0.117, range=0..1))
evaluate_curve = EvaluateCurve(Curve=contour, Parameter=0)  # -> Point, Tangent, Angle
deconstruct_2 = Deconstruct(Point=evaluate_curve.Point)  # -> XComponent, YComponent, ZComponent
bounds_3 = Bounds(Numbers=flatten(deconstruct_2.ZComponent))
deconstruct_domain = DeconstructDomain(Domain=bounds_3)  # -> Start, End
gradient = Gradient(
    LowerLimit=deconstruct_domain.Start,
    UpperLimit=deconstruct_domain.End,
    Parameter=flatten(deconstruct_2.ZComponent),
    stops=[0: RGB(234, 126, 0), 0.00354: RGB(67, 122, 224), 1: RGB(217, 209, 61), 1: RGB(75, 107, 169), 1: RGB(173, 203, 249)])
custom_preview = CustomPreview(Geometry=flatten(contour), Material=gradient)
createattributes = CreateAttributes(LayerName="1", Color=gradient, enableFullPath=False)
bake_geometry_2 = BakeGeometry(Bake=Button(), Geometry=flatten(contour), Attributes=createattributes, DeleteOldBakes=False, PreserveTrees=False)
